# Grasshopper definition Example.gh (Grasshopper 1.0.7)
# plug-ins: Sasquatch, Kangaroo2 Components

surface = Surface(reparameterize(<surface referenced from the Rhino model>))
surface_2 = Surface(reparameterize(<surface referenced from the Rhino model>))
surface_3 = Surface(reparameterize(<surface referenced from the Rhino model>))

# ----
# Planar surface
surface_4 = Surface(reparameterize(<surface referenced from the Rhino model>))

surface_5 = Surface(reparameterize(<surface referenced from the Rhino model>))
surface_6 = Surface(reparameterize(<surface referenced from the Rhino model>))
surface_7 = Surface(reparameterize(<surface referenced from the Rhino model>))

# ----
# Surface
surface_8 = Surface(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)
surface_9 = Surface(<surface referenced from the Rhino model>)
# Graphics on plan
curve = Curve([<curve referenced from the Rhino model> x135])
explode = Explode(Curve=curve, Recursive=True)  # -> Segments, simplify(Vertices)
merge = Merge(Data1=surface_5, Data2=surface_6, Data3=surface_7)
merge_2 = Merge(Data1=surface_2, Data2=surface, Data3=surface_3)  # -> graft(Result)
flip = Flip(Surface=merge)  # -> Surface, Result
flip_2 = Flip(Surface=merge_2)  # -> Surface, Result
removeduplicatepts = RemoveDuplicatePts(Points=explode.Vertices, Tolerance=0.01)  # -> simplify(UniquePoints)
merge_3 = Merge(Data1=simplify(surface_8), Data2=flip_2.Surface)  # -> flatten(Result)
merge_4 = Merge(Data1=surface_4, Data2=flip.Surface)
closest_brep = ClosestBrep(Breps=merge_4, Point=removeduplicatepts, strictClosestBrep=True)  # -> BrepIndex, ClosestPoint, ClosestNormal
list_item = ListItem(List=merge_3, Index=closest_brep.BrepIndex, Wrap=True)
list_item_2 = ListItem(List=merge_4, Index=closest_brep.BrepIndex, Wrap=True)
surface_closest_point = SurfaceClosestPoint(Point=removeduplicatepts, Surface=list_item_2)  # -> Point, UVPoint, Distance
panel = Panel(surface_closest_point.UVPoint)
evaluate_surface = EvaluateSurface(Surface=list_item, Point=panel)  # -> Point, Normal, UDirection, VDirection, Frame
# 數量
# 數量
# 柄寬
# 旋轉寬
# 順序調整
# 邊緣切割
# 順序調整
# Graphics on surface
polyline = PolyLine(Vertices=evaluate_surface.Point, Closed=True)
